# Grasshopper definition euclidean_geometry.gh (Grasshopper 1.0.7)

python = GhPythonScript()  # -> out, file
# ---------- python: Python ----------
# script to generate a file for .gcode

import rhinoscriptsyntax as rs

filter = "GCode (*.gcode)|*.gcode|All Files (*.*)|*.*||"
file = rs.SaveFileName("", filter)
# ---------- end python ----------
python_2 = GhPythonScript(file=python.file, radius=Slider(20, range=0..100))  # -> out, lines, turtle, print_bed
# ---------- python_2: Python ----------
# code required so that library reloads appropriately
# must be above other import statements
import sys
import operator as op
to_delete = list()
for module in sys.modules:
    if "extruder_turtle" in module:
      to_delete.append(module)
    if "turtle_utilities" in module:
      to_delete.append(module)
for module in to_delete:
    sys.modules.pop(module)
    

import rhinoscriptsyntax as rs
import extruder_turtle
import turtle_utilities as tu
from extruder_turtle import *
import math


# set up the turtle
t = ExtruderTurtle()
t.setup(x=0, y=0, z=0.0, filename=file, printer = "micro")
# print out printer information
t.print_printer_information()

r = radius
for i in range (0,360):
    x = r * math.cos(math.radians(i))
    y = r * math.sin(math.radians(i))
    t.set_position(x,y)

# visualize the turtle's location and position
turtle = t.draw_turtle()
print_bed = t.draw_print_bed()

# visualize the turtle's path
lines = t.get_lines()

# close the generated .gcode file
t.finish()
# ---------- end python_2 ----------
