# Grasshopper definition turtle_slice.gh (Grasshopper 1.0.7)

# ----
# Sample shape to slice
radius_bottom = Slider(20, range=3..100)
radius_mid = Slider(35, range=3..100)
radius_top = Slider(31, range=3..100)
height = Slider(60, range=3..100)
facets = Slider(8, range=3..20)
python = GhPythonScript(facets=facets, height=height, radius_top=radius_top, radius_mid=radius_mid, radius_bottom=radius_bottom)  # -> out, points, polygons, curves; inputs facets: Int32
# ---------- python: Python ----------
__author__ = "Leah"

import rhinoscriptsyntax as rs
import math

def polyPoints (z, r):
    points = []
    for i in range (0,facets+1):
        angle = i*360/facets
        x = r*math.cos(math.radians(angle))
        y = r*math.sin(math.radians(angle))
        points.append(rs.CreatePoint(x,y,z))
    return points
    
def polygon(z, r):
    points = polyPoints(z,r)
    polygon = rs.AddPolyline(points)
    return polygon

def curvePoly(z, r):
    points = polyPoints(z,r)
    curve = rs.AddCurve(points,2)
    return curve

polygons = []
polygons.append(polygon(0,radius_bottom))
polygons.append(polygon(height/2,radius_mid))
polygons.append(polygon(height,radius_top))

curves = []
curves.append(curvePoly(0,radius_bottom))
curves.append(curvePoly(height/2,radius_mid))
curves.append(curvePoly(height,radius_top))

    
def cosPoints(z,in_r,a,b):
    points = []
    for i in range (0,360+1):
        r = in_r+a+a*math.cos(math.radians(i)*b)
        x = r*math.cos(math.radians(i))
        y = r*math.sin(math.radians(i))
        points.append(rs.CreatePoint(x,y,z))
    return points

def cosPoly(z,in_r,a,b):
    points = cosPoints(z,in_r,a,b)
    curve = rs.AddCurve(points)
    curve = rs.CloseCurve(curve,1)
    return curve
    
    
curves = []
curves.append(cosPoly(0,radius_bottom,2,5))
curves.append(cosPoly(height/2,radius_mid,2,10))
curves.append(cosPoly(height,radius_top,2,5))
# ---------- end python ----------
loft = Loft(Curves=python.curves, Options={Adjust=False, Closed=False, LoftEnds=0, LoftSimp=0, LoftType=0, Rebuild=10, Refit=0.01})
cap = CapHoles(Brep=loft)

trigger = Trigger(Interval=-1, TimerInterval=5, Target=python_2)  # disabled
python_2 = GhPythonScript()  # -> out, file
# ---------- python_2: Python ----------
import rhinoscriptsyntax as rs

filter = "GCode (*.gcode)|*.gcode|All Files (*.*)|*.*||"
file = rs.SaveFileName("", filter)
# ---------- end python_2 ----------
python_3 = GhPythonScript(filename=python_2.file, shape=cap)  # -> out, lines, turtle; inputs shape: Brep
# ---------- python_3: Python ----------
import rhinoscriptsyntax as rs
import extruder_turtle
import turtle_utilities as tu
from extruder_turtle import *

# set up the turtle
t = ExtruderTurtle()
t.setup(x=0, y=0, z=0.0, filename=filename, printer = "3D potter")

# slice the shape
# this function generates a turtle path that 
# follows the outer perimeter of the shape
# note: does not create a bottom
tu.slice_with_turtle(t, shape, walls = 1)

# visualize the turtle's path
lines = t.get_lines()

# close the generated .gcode file
t.finish()
# ---------- end python_3 ----------
