# Grasshopper definition turtle_slice.gh (Grasshopper 1.0.7)

# ----
# Sample shape to slice
radius_bottom = Slider(20, range=3..100)
radius_top = Slider(18, range=1..100)
radius_mid = Slider(52, range=3..100)
height = Slider(104, range=3..200)
facets = Slider(12, range=3..20)
python = GhPythonScript(facets=facets, height=height, radius_top=radius_top, radius_mid=radius_mid, radius_bottom=radius_bottom)  # -> out, points, polygons, curves; inputs facets: Int32
# ---------- python: Python ----------
# code required so that library reloads appropriately
# must be above other import statements
import sys
import operator as op
to_delete = list()
for module in sys.modules:
    if "extruder_turtle" in module:
      to_delete.append(module)
    if "turtle_utilities" in module:
      to_delete.append(module)
for module in to_delete:
    sys.modules.pop(module)
    
import rhinoscriptsyntax as rs
import extruder_turtle  
import turtle_utilities as tu
from extruder_turtle import *
import math
import Rhino.Geometry as geom

reload(extruder_turtle)


def polyPoints (z, r):
    points = []
    for i in range (0,facets+1):
        angle = i*360/facets
        x = r*math.cos(math.radians(angle))
        y = r*math.sin(math.radians(angle))
        points.append(rs.CreatePoint(x,y,z))
    return points
    
def polygon(z, r):
    points = polyPoints(z,r)
    polygon = rs.AddPolyline(points)
    return polygon

def curvePoly(z, r):
    points = polyPoints(z,r)
    curve = rs.AddCurve(points,2)
    return curve

polygons = []
polygons.append(polygon(0,radius_bottom))
polygons.append(polygon(height/2,radius_mid))
polygons.append(polygon(height,radius_top))

curves = []
curves.append(curvePoly(0,radius_bottom))
curves.append(curvePoly(height/2,radius_mid))
curves.append(curvePoly(height,radius_top))
    
def cosPoints(z,in_r,a,b):
    points = []
    for i in range (0,360+1):
        r = in_r+a+a*math.cos(math.radians(i)*b)
        x = r*math.cos(math.radians(i))
        y = r*math.sin(math.radians(i))
        points.append(rs.CreatePoint(x,y,z))
    return points

def cosPoly(z,in_r,a,b):
    points = cosPoints(z,in_r,a,b)
    curve = rs.AddCurve(points)
    curve = rs.CloseCurve(curve,1)
    return curve
'''
amp = 3.5
curves = []
curves.append(cosPoly(0,radius_bottom,amp,facets))
curves.append(cosPoly(height/3,radius_mid,amp,facets))
curves.append(cosPoly(height/2+30,16,amp,facets/2))
curves.append(cosPoly(height,radius_top,amp-1,5))
'''
# ---------- end python ----------
loft = Loft(Curves=python.curves, Options={Adjust=False, Closed=False, LoftEnds=0, LoftSimp=0, LoftType=0, Rebuild=10, Refit=0.01})
cap = CapHoles(Brep=loft)

trigger = Trigger(Interval=-1000, TimerInterval=1000, Target=python_2)
python_2 = GhPythonScript()  # -> out, file
# ---------- python_2: Python ----------
import rhinoscriptsyntax as rs

filter = "GCode (*.gcode)|*.gcode|All Files (*.*)|*.*||"
file = rs.SaveFileName("", filter)
# ---------- end python_2 ----------
dam = DataDam(DataB=python_2.file, DataA=cap, BufferDelay=10000000, BufferMode=0)  # -> DataB, DataA
python_3 = GhPythonScript(filename=dam.DataB, shape=dam.DataA)  # -> out, lines, turtle, bed; inputs shape: Brep
# ---------- python_3: Python ----------
# code required so that library reloads appropriately
# must be above other import statements
import sys
import operator as op
to_delete = list()
for module in sys.modules:
    if "extruder_turtle" in module:
      to_delete.append(module)
    if "turtle_utilities" in module:
      to_delete.append(module)
for module in to_delete:
    sys.modules.pop(module)
    
import rhinoscriptsyntax as rs
import extruder_turtle  
import turtle_utilities as tu
from extruder_turtle import *

reload(extruder_turtle)

# set up the turtle
t = ExtruderTurtle()
t.setup(x=0, y=0, z=0.0, filename=filename, printer = "eazao")

# slice the shape
# this function generates a turtle path that 
# follows the outer perimeter of the shape
slices = tu.slice_with_turtle(t, shape, walls = 1, spiral_up = True, bottom = 3)

# visualize the turtle's path
lines = t.get_lines()

bed = t.draw_print_bed()
t.volume_of_path(print_out=True)

# close the generated .gcode file
t.finish()
# ---------- end python_3 ----------
